# Grasshopper definition sDNA_build_components.gh (Grasshopper 1.0.7)

path = FilePath("C:\Users\James\Documents\Rhino\Grasshopper\sDNA\source\repos\GHsDNAv0.01\sDNA_GH\launcher.py")
panel = Panel("""#! /usr/bin/awk NR==3
# -*- coding: utf-8 -*-
# This module requires Grasshopper Python (Rhino3D)

# MIT License

# Copyright (c) [2021] [Cardiff University, a body incorporated
# by Royal Charter and a registered charity (number:
# 1136855) whose administrative offices are at 7th floor 30-
# 36 Newport Road, University CF24 0DE, Wales, UK]

# Permission is hereby granted, free of charge, to any person obtaining a copy
# of this software and associated documentation files (the "Software"), to deal
# in the Software without restriction, including without limitation the rights
# to use, copy, modify, merge, publish, distribute, sublicense, and/or sell
# copies of the Software, and to permit persons to whom the Software is
# furnished to do so, subject to the following conditions:

# The above copyright notice and this permission notice shall be included in all
# copies or substantial portions of the Software.

# THE SOFTWARE IS PROVIDED "AS IS", WITHOUT WARRANTY OF ANY KIND, EXPRESS OR
# IMPLIED, INCLUDING BUT NOT LIMITED TO THE WARRANTIES OF MERCHANTABILITY,
# FITNESS FOR A PARTICULAR PURPOSE AND NONINFRINGEMENT. IN NO EVENT SHALL THE
# AUTHORS OR COPYRIGHT HOLDERS BE LIABLE FOR ANY CLAIM, DAMAGES OR OTHER
# LIABILITY, WHETHER IN AN ACTION OF CONTRACT, TORT OR OTHERWISE, ARISING FROM,
# OUT OF OR IN CONNECTION WITH THE SOFTWARE OR THE USE OR OTHER DEALINGS IN THE
# SOFTWARE.



\"\"\" Main entry point to launch sDNA_GH if run as a script from an sDNA_GH GhPython component.

    Imports the python package sDNA_GH and (re)defining the MyComponent(component) 
    class.  Grasshopper instantiates this class in each such component, then 
    calls its RunScript method 
    (and recalls it on each Param update / recalculation).

    There may be multiple components, all running this same launcher code.
    Therefore we want the root logger to live in the sDNA_GH.main module
    that they each import.  The logging system is configurable by the user,
    but only through the options that are read in during the main package
    import, and we want to create logs before this too, in this module.  So 
    before a component has imported sDNA_GH.main, logging is routed through output, 
    a callable instance of Output, with a cache, defined below.  After a logger has 
    been set up according to the user's configuration, after the main package import,
    output's cache is flushed through the normal logging system, 

    Also, the Output class is used to define two Classes from this single 
    code definition.  Python scripts can happily import themselves, but here
    this is because launcher.py is itself part of the imported sDNA_GH python
    package, imported by launcher.py in a GhPythoncomponent.  To achieve this, the 
    code in this file needs to be copied into the sDNA_GH GhPython components 
    during building of the components (e.g. via the code input Param), 

    The behaviours can be different of course if changes are made to one and not
    the other. e.g. if updated code is forgotten to be copied into the component.

    A dummy MyComponent(component) class is defined in the script to appease
    GhPython's parser, even though the definition we use is imported from the package

    launcher.py can also run unittests in a component named "selftest" 
\"\"\"

__author__ = 'James Parrott'
__version__ = '0.04'



import sys
import os
import functools
import importlib

from ghpythonlib.componentbase import executingcomponent as component
import Grasshopper
import scriptcontext as sc

import_module = importlib.import_module
try:
    reload #type: ignore
except NameError:
    reload = importlib.reload

try:
    basestring #type: ignore
except NameError:
    basestring = str

try:
    ghdoc #type: ignore
except NameError:
    from .custom.skel.basic.ghdoc import ghdoc

package_name = 'sDNA_GH'
plug_in_name = 'sDNA'               
reload_already_imported = False
repo_folder = os.path.dirname( os.path.dirname(ghdoc.Path) ) if ghdoc.Path else None
user_install_folder = Grasshopper.Folders.DefaultUserObjectFolder




class Output(object): 

    def set_logger(self, logger, flush = True):
        self.logger = logger
        if flush and self.tmp_logs:
            self.flush()

    def __init__(self
                ,tmp_logs = None
                ,logger = None
                ):
        if not isinstance(tmp_logs, list): #assert not isinstance(None, list)
            tmp_logs = []
        self.tmp_logs = tmp_logs
        self.set_logger(logger, flush = False)



    def store(self, message, logging_level):
        self.tmp_logs.append( (message, logging_level) )

    def __call__(self, message, logging_level = "INFO", logging_dict = {}):
        #type: (str, str, dict, list) -> str
        
        #logger.debug(s)

        if logging_dict == {} and self.logger is not None: 
            logging_dict = dict( DEBUG = self.logger.debug
                                ,INFO = self.logger.info
                                ,WARNING = self.logger.warning
                                ,ERROR = self.logger.error
                                ,CRITICAL = self.logger.critical
                                )

        logging_level = logging_level.upper()
        if logging_level in logging_dict:
            logging_dict[logging_level](message)
        else:
            self.store(message, logging_level)

        return '%s : %s ' % (logging_level, message)

    def __getattr__(self, attr):
        return functools.partial(self.__call__, logging_level = attr.upper())

    def flush(self):
        tmp_logs = self.tmp_logs[:] # __call__ might cache back to tmp_logs
        self.tmp_logs[:] = [] # Mutate list initialised with.  Avoid double 
                              # logging in case re - stored in tmp_logs
        for tmp_log_message, tmp_log_level in tmp_logs:
            self.__call__(tmp_log_message, tmp_log_level)

output = Output()


class InvalidArgsError(Exception):
    
    \"\"\"Custom exception to log the error message, and to at least allow 
       attempts to give users actionable advice to fix the issue, in 
       the event of a problem.  
    \"\"\"
    message_fmt = 'Invalid import args: %s'
    def __init__(self
                ,message_fmt = ''
                ,message = ''
                ,logger = output
                , **kwargs
                ):
        if message_fmt and isinstance(message_fmt, basestring):
            self.message_fmt = message_fmt
        if not message or not isinstance(message, basestring):
            message = self.message_fmt % kwargs
        logger.error(message)
        self.kwargs = kwargs
        super(Exception, self).__init__(message)    


class ModuleNameError(InvalidArgsError):
    message_fmt = 'Invalid module name: %s'


class FilePathError(InvalidArgsError):
    message_fmt = 'Invalid path to import module from: %s'


# We only know the sDNA version to import as a string.  This is more secure too.
def strict_import(module_name = ''
                 ,folder = ''
                 ,sub_folder = ''
                 ,logger = output
                 ,reload_already_imported = reload_already_imported
                 ):

    # type: (str, str, str, type[any], bool) -> type[any]
    \"\"\" Imports the named module from the specified folder\subfolder only, 
        and returns it.
        
        Avoids name clashes and casual hijack attempts.  In some 
        environments supporting a Python implementation (such as 
        GhPython in Grasshopper) it may not be desireable to ask the user 
        to set PYTHONPATH.  Hence here, we save sys.path to a tmp 
        variable, set sys.path to the specified folders, attempt the 
        import in a try: block, and restore sys.path in a finally: block
    \"\"\"
    if not module_name or not isinstance(module_name, basestring):
        raise ModuleNameError(module_name = module_name
                             ,folder = folder
                             ,sub_folder = sub_folder
                             ,logger = logger
                             )
    logger.debug(module_name)
    if module_name in sys.modules:   # sys.modules is also shared between GHPython components 
                                     # (and is even saved until Rhino is closed).
        logger.debug('Module %s already in sys.modules' % module_name)
        if reload_already_imported:
            logger.debug('Reloading %s.... ' % module_name)
            reload(sys.modules[module_name]) # type: ignore
        return sys.modules[module_name]
    #
    #
    # Load module_name for first time:
    #
    #
    search_path = os.path.join(folder, sub_folder)

    if (search_path 
        and isinstance(search_path, basestring) 
        and os.path.isdir(search_path)):
        #
        logger.debug('Search path == %s' % search_path)
        #if search_folder_only:
        #    sys.path = [search_path]
        if search_path not in sys.path:
            sys.path.insert(0, search_path)
    else:
        raise FilePathError(module_name = module_name
                           ,search_path = search_path
                           ,logger = logger
                           )

    logger.debug('Trying import... ')
    module = import_module(module_name, '')           

    return module       


class ModulesNotFoundError(InvalidArgsError):
    message_fmt = 'Modules not found in any location %s'


def load_modules(m_names
                ,folders
                ,logger = output
                ,module_name_error_msg = 'Please supply valid names of modules to import, %s'
                ,folders_error_msg = 'Please supply valid folders to import from. %s'
                ,modules_not_found_msg = 'Specified modules not found in any folder, %s'):
    #type(str/ Iterable, list, type[any], str, str) -> tuple / None
    \"\"\" Tries to import all modules in m_names, from the first folder in 
        folders to contain a .py or .pyc files with the same name as each 
        module.

        Returns a tuple of all the modules and the path they were found in.  Else 
        raises a ModulesNotFoundError.
    \"\"\"
    if not m_names or any( not isinstance(m_name, basestring) 
                               for m_name in m_names ):
        raise ModuleNameError(message_fmt = module_name_error_msg
                             ,m_names = m_names
                             ,logger = logger
                             )
    
    if isinstance(m_names, basestring):
        m_names = [m_names] 
    logger.debug('m_names == %s of type : %s' % (m_names, type(m_names).__name__))

    logger.debug('Testing paths : %s ' % folders)
    
    if isinstance(folders, basestring):
        folders = [folders]

    if not any(os.path.isdir(folder) or os.path.isdir(os.path.dirname(folder)) 
               for folder in folders
              ):
        raise FilePathError(message_fmt = folders_error_msg
                           ,m_names = m_names
                           ,logger = logger
                           )

    for folder in folders:
        logger.debug('Type(folder) : %s' % type(folder).__name__)
        logger.debug('Type(path) : %s path == %s' %(type(folder).__name__, folder))

        if os.path.isfile(folder):
            folder = os.path.dirname(folder)
        if all( any(os.path.isfile(os.path.join(folder, name.replace('.', os.sep) + ending)) 
                    for ending in ['.py','.pyc'] 
                   )
                for name in m_names
              ):
            #
            logger.debug('Importing %s' % repr(m_names))

            return tuple(strict_import(name, folder, '', logger = logger) 
                            for name in m_names
                        ) + (folder,)
            # tuple of modules, followed by the path to them
    raise ModulesNotFoundError(message_fmt = modules_not_found_msg
                              ,m_names = m_names
                              ,folders = folders
                              ,logger = logger
                              )




if __name__ == '__main__': # False in a compiled component.  But then the user
                           # can't add or remove Params to the component.  
    
    # Grasshopper will look for class MyComponent(component) in global scope
    # so a main function is a little tricky to define.

    nick_name = ghenv.Component.NickName #type: ignore

    if (repo_folder and 
        nick_name.replace(' ','').replace('_','').lower() == 'buildcomponents'):
        #
        sDNA_GH_search_paths = repo_folder 
        # builder can only load sDNA_GH from its parent directory, 
        # e.g. if in a dir one level up in the main repo
        # such as sDNA_build_components.gh.
    else:
        sDNA_GH_search_paths = user_install_folder


    sc.doc = ghdoc #type: ignore

    output.debug(sDNA_GH_search_paths)

    class sDNA_GH(object):
        pass

    if 'sDNA_GH.main' in sys.modules:
        sDNA_GH.main = sys.modules['sDNA_GH.main']
    else:
        sDNA_GH.main, _ = load_modules(m_names = package_name + '.main'
                                      ,folders = sDNA_GH_search_paths
                                      ,folders_error_msg = 'Please ensure a folder called %s' % package_name 
                                                          +' is created in '
                                                          +Grasshopper.Folders.DefaultUserObjectFolder                                                                    
                                                          +', containing main.py and all sDNA_GH python' 
                                                          +' files and subfolders. ' 
                                      ,modules_not_found_msg = 'Some sDNA_GH files may be missing.  Please copy'
                                                              +' sDNA_GH.zip into: '
                                                              +Grasshopper.Folders.DefaultUserObjectFolder
                                                              +', Unblock it if necessary, and then right click'
                                                              +' it and select Extract All... in that location. '
                                                              +' Ensure that main.py and all sDNA_GH python' 
                                                              +' files and subfolders are inside: '
                                                              +os.path.join(Grasshopper.Folders.DefaultUserObjectFolder
                                                                           ,package_name
                                                                           )
                                      )         


    logger = sDNA_GH.main.logger.getChild('launcher')
    output.set_logger(logger, flush = True)


    class MyComponent(component):
        pass  # Required.  Idiomatic to Grasshopper.  Must be called "MyComponent"  
            # too (it is looked for by the parser or scope checker?) otherwise 
            # Grasshopper may not find the subclass of on 
            # component.  Even though we overwrite this class on the next line
            # immediately below.  

    MyComponent = sDNA_GH.main.sDNA_GH_Component


    if nick_name.replace(' ','').replace('_','').lower() == 'selftest':  

        if sys.argv[0].endswith(os.path.join(package_name,'__main__.py')):   
            from .tests.unit_tests import unit_tests_sDNA_GH
        else:
            unit_tests_sDNA_GH, _ = load_modules('sDNA_GH.tests.unit_tests.unit_tests_sDNA_GH'
                                                ,sDNA_GH_search_paths
                                                )

        MyComponent._RunScript = MyComponent.RunScript
        MyComponent.RunScript = unit_tests_sDNA_GH.run_launcher_tests  """)
# .shp
# Analysis
# Calibration
# Data
# Dev
# Extra
# Geom
# Plot
# Preparation
sdna_gh = Text("sDNA_GH")
file = ReadFile(File=path, PerLineParse=False)
build_components = GhPythonScript()  # -> out; disabled
# ---------- build_components: Python ----------
from ghpythonlib.componentbase import executingcomponent as component
import Grasshopper, GhPython
import System
import Rhino
import rhinoscriptsyntax as rs

class MyComponent(component):
    
    def RunScript(self, x, y):
        """Provides a scripting component.
            Inputs:
                x: The x script variable
                y: The y script variable
            Output:
                a: The a output variable"""
        
        __author__ = "James"
        __version__ = "2022.07.13"
        
        import rhinoscriptsyntax as rs
        
        # return outputs if you have them; here I try it for you:
        return a
# ---------- end build_components ----------
build_components_2 = GhPythonScript(go=Toggle(True))  # -> out, OK, opts; inputs go: list, opts: list
#   port go: true: runs tools. false: do not run tools but still read other Params.
#   port opts: sDNA_GH options data structure. Python dictionary.
#   port OK: true: tools ran successfully. false: tools did not run, or there was an error.
#   port opts: sDNA_GH options data structure. Python dictionary.
# ---------- build_components_2: Python ----------
#! /usr/bin/awk NR==3
# -*- coding: utf-8 -*-
# This module requires Grasshopper Python (Rhino3D)

# MIT License

# Copyright (c) [2021] [Cardiff University, a body incorporated
# by Royal Charter and a registered charity (number:
# 1136855) whose administrative offices are at 7th floor 30-
# 36 Newport Road, University CF24 0DE, Wales, UK]

# Permission is hereby granted, free of charge, to any person obtaining a copy
# of this software and associated documentation files (the "Software"), to deal
# in the Software without restriction, including without limitation the rights
# to use, copy, modify, merge, publish, distribute, sublicense, and/or sell
# copies of the Software, and to permit persons to whom the Software is
# furnished to do so, subject to the following conditions:

# The above copyright notice and this permission notice shall be included in all
# copies or substantial portions of the Software.

# THE SOFTWARE IS PROVIDED "AS IS", WITHOUT WARRANTY OF ANY KIND, EXPRESS OR
# IMPLIED, INCLUDING BUT NOT LIMITED TO THE WARRANTIES OF MERCHANTABILITY,
# FITNESS FOR A PARTICULAR PURPOSE AND NONINFRINGEMENT. IN NO EVENT SHALL THE
# AUTHORS OR COPYRIGHT HOLDERS BE LIABLE FOR ANY CLAIM, DAMAGES OR OTHER
# LIABILITY, WHETHER IN AN ACTION OF CONTRACT, TORT OR OTHERWISE, ARISING FROM,
# OUT OF OR IN CONNECTION WITH THE SOFTWARE OR THE USE OR OTHER DEALINGS IN THE
# SOFTWARE.



""" Main entry point to launch sDNA_GH if run as a script from an sDNA_GH GhPython component.

    Imports the python package sDNA_GH and (re)defining the MyComponent(component) 
    class.  Grasshopper instantiates this class in each such component, then 
    calls its RunScript method 
    (and recalls it on each Param update / recalculation).

    There may be multiple components, all running this same launcher code.
    Therefore we want the root logger to live in the sDNA_GH.main module
    that they each import.  The logging system is configurable by the user,
    but only through the options that are read in during the main package
    import, and we want to create logs before this too, in this module.  So 
    before a component has imported sDNA_GH.main, logging is routed through output, 
    a callable instance of Output, with a cache, defined below.  After a logger has 
    been set up according to the user's configuration, after the main package import,
    output's cache is flushed through the normal logging system, 

    Also, the Output class is used to define two Classes from this single 
    code definition.  Python scripts can happily import themselves, but here
    this is because launcher.py is itself part of the imported sDNA_GH python
    package, imported by launcher.py in a GhPython component.  To achieve this, the 
    code in this file needs to be copied into the sDNA_GH GhPython components 
    during building of the components (e.g. via the code input Param), 

    The behaviours can be different of course if changes are made to one and not
    the other. e.g. if updated code is forgotten to be copied into the component.

    A dummy MyComponent(component) class is defined in the script to appease
    GhPython's parser, even though the definition we use is imported from the package

    launcher.py can also run unit tests in a component named "selftest" 
"""

__author__ = 'James Parrott'
__version__ = '0.06'



import sys
import os
import functools
import importlib

from ghpythonlib.componentbase import executingcomponent as component
import Grasshopper
import scriptcontext as sc

import_module = importlib.import_module
try:
    reload #type: ignore
except NameError:
    reload = importlib.reload

try:
    basestring #type: ignore
except NameError:
    basestring = str

try:
    ghdoc #type: ignore
except NameError:
    from .custom.skel.basic.ghdoc import ghdoc

package_name = 'sDNA_GH'
plug_in_name = 'sDNA'               
reload_already_imported = False
repo_folder = os.path.dirname( os.path.dirname(ghdoc.Path) ) if ghdoc.Path else None
# Assume we are in repo_folder/dev/sDNA_build_components.gh

user_install_folder = Grasshopper.Folders.DefaultUserObjectFolder
selftest = 'selftest'




class Output(object): 

    def set_logger(self, logger, flush = True):
        self.logger = logger
        if flush and self.tmp_logs:
            self.flush()

    def __init__(self
                ,tmp_logs = None
                ,logger = None
                ):
        if not isinstance(tmp_logs, list): #assert not isinstance(None, list)
            tmp_logs = []
        self.tmp_logs = tmp_logs
        self.set_logger(logger, flush = False)



    def store(self, message, logging_level):
        self.tmp_logs.append( (message, logging_level) )

    def __call__(self, message, logging_level = "INFO", logging_dict = {}):
        #type: (str, str, dict, list) -> str
        
        #logger.debug(s)

        if logging_dict == {} and self.logger is not None: 
            logging_dict = dict( DEBUG = self.logger.debug
                                ,INFO = self.logger.info
                                ,WARNING = self.logger.warning
                                ,ERROR = self.logger.error
                                ,CRITICAL = self.logger.critical
                                )

        logging_level = logging_level.upper()
        if logging_level in logging_dict:
            logging_dict[logging_level](message)
        else:
            self.store(message, logging_level)

        return '%s : %s ' % (logging_level, message)

    def __getattr__(self, attr):
        return functools.partial(self.__call__, logging_level = attr.upper())

    def flush(self):
        tmp_logs = self.tmp_logs[:] # __call__ might cache back to tmp_logs
        self.tmp_logs[:] = [] # Mutate list initialised with.  Avoid double 
                              # logging in case re - stored in tmp_logs
        for tmp_log_message, tmp_log_level in tmp_logs:
            self.__call__(tmp_log_message, tmp_log_level)

output = Output()


class InvalidArgsError(Exception):
    
    """Custom exception to log the error message, and to at least allow 
       attempts to give users actionable advice to fix the issue, in 
       the event of a problem.  
    """
    message_fmt = 'Invalid import args: %s'
    def __init__(self
                ,message_fmt = ''
                ,message = ''
                ,logger = output
                , **kwargs
                ):
        if message_fmt and isinstance(message_fmt, basestring):
            self.message_fmt = message_fmt
        if kwargs and (not message or not isinstance(message, basestring)):
            message = self.message_fmt % kwargs
        logger.error(message)
        self.kwargs = kwargs
        super(Exception, self).__init__(message)    


class ModuleNameError(InvalidArgsError):
    message_fmt = 'Invalid module name: %s'


class FilePathError(InvalidArgsError):
    message_fmt = 'Invalid path to import module from: %s'


# We only know the sDNA version to import as a string.  This is more secure too.
def strict_import(module_name = ''
                 ,folder = ''
                 ,sub_folder = ''
                 ,logger = output
                 ,reload_already_imported = reload_already_imported
                 ):

    # type: (str, str, str, type[any], bool) -> type[any]
    """ Imports the named module from the specified folder\subfolder only, 
        and returns it.
        
        Avoids name clashes and casual hijack attempts.  In some 
        environments supporting a Python implementation (such as 
        GhPython in Grasshopper) it may not be desirable to ask the user 
        to set PYTHONPATH.  Hence here, we save sys.path to a tmp 
        variable, set sys.path to the specified folders, attempt the 
        import in a try: block, and restore sys.path in a finally: block
    """
    if not module_name or not isinstance(module_name, basestring):
        raise ModuleNameError(module_name = module_name
                             ,folder = folder
                             ,sub_folder = sub_folder
                             ,logger = logger
                             )
    logger.debug(module_name)
    if module_name in sys.modules:   # sys.modules is also shared between GHPython components 
                                     # (and is even saved until Rhino is closed).
        logger.debug('Module %s already in sys.modules' % module_name)
        if reload_already_imported:
            logger.debug('Reloading %s.... ' % module_name)
            reload(sys.modules[module_name]) # type: ignore
        return sys.modules[module_name]
    #
    #
    # Load module_name for first time:
    #
    #
    search_path = os.path.join(folder, sub_folder)

    if (search_path 
        and isinstance(search_path, basestring) 
        and os.path.isdir(search_path)):
        #
        logger.debug('Search path == %s' % search_path)
        #if search_folder_only:
        #    sys.path = [search_path]
        if search_path not in sys.path:
            sys.path.insert(0, search_path)
    else:
        raise FilePathError(module_name = module_name
                           ,search_path = search_path
                           ,logger = logger
                           )

    logger.debug('Trying import... ')
    module = import_module(module_name, '')           

    return module       


class ModulesNotFoundError(InvalidArgsError):
    message_fmt = 'Modules not found in any location %s'


def load_modules(m_names
                ,folders
                ,logger = output
                ,module_name_error_msg = 'Please supply valid names of modules to import, %s'
                ,folders_error_msg = 'Please supply valid folders to import from. %s'
                ,modules_not_found_msg = 'Specified modules not found in any folder, %s'):
    #type(str/ Iterable, list, type[any], str, str) -> tuple / None
    """ Tries to import all modules in m_names, from the first folder in 
        folders to contain a .py or .pyc files with the same name as each 
        module.

        Returns a tuple of all the modules and the path they were found in.  Else 
        raises a ModulesNotFoundError.
    """
    if not m_names:
        raise ModuleNameError(message_fmt = 'No module names supplied, m_names = %s'
                             ,m_names = m_names
                             ,logger = logger
                             )

    if any( not isinstance(m_name, basestring) for m_name in m_names ):
        # if m_names is a basestring, the error is not raised 
        raise ModuleNameError(message_fmt = module_name_error_msg
                             ,m_names = m_names
                             ,logger = logger
                             )
    
    if isinstance(m_names, basestring):
        m_names = [m_names] 

    logger.debug('m_names == %s of type : %s' % (m_names, type(m_names).__name__))

    logger.debug('Testing paths : %s ' % folders)
    
    if isinstance(folders, basestring):
        folders = [folders]

    if not any(os.path.isdir(folder) or os.path.isdir(os.path.dirname(folder)) 
               for folder in folders
              ):
        raise FilePathError(message_fmt = folders_error_msg
                           ,m_names = m_names
                           ,logger = logger
                           )

    for folder in folders:
        logger.debug('Type(folder) : %s' % type(folder).__name__)
        logger.debug('Type(path) : %s path == %s' %(type(folder).__name__, folder))

        if os.path.isfile(folder):
            folder = os.path.dirname(folder)
        if all( any(os.path.isfile(os.path.join(folder, name.replace('.', os.sep) + ending)) 
                    for ending in ['.py','.pyc'] 
                   )
                for name in m_names
              ):
            #
            logger.debug('Importing %s' % repr(m_names))

            return tuple(strict_import(name, folder, '', logger = logger) 
                         for name in m_names
                        ) + (folder,)
            # tuple of modules, followed by the path to them
    raise ModulesNotFoundError(message_fmt = modules_not_found_msg
                              ,m_names = m_names
                              ,folders = folders
                              ,logger = logger
                              )




if __name__ == '__main__': # False in a compiled component.  But then the user
                           # can't add or remove Params to the component.  
    
    # Grasshopper will look for class MyComponent(component) in global scope
    # so a main function is a little tricky to define.

    nick_name = ghenv.Component.NickName #type: ignore


    if (repo_folder and 
        nick_name == 'Build_components'):
        #
        sDNA_GH_search_path = repo_folder 
        # builder can only load sDNA_GH from its parent directory, 
        # e.g. if in a dir one level up in the main repo
        # such as sDNA_build_components.gh.
    else:
        sDNA_GH_search_path = user_install_folder


    sc.doc = ghdoc #type: ignore

    output.debug(sDNA_GH_search_path)

    class sDNA_GH(object):
        pass

    if 'sDNA_GH.main' in sys.modules:
        sDNA_GH.main = sys.modules['sDNA_GH.main']
    else:
        sDNA_GH.main, _ = load_modules(m_names = package_name + '.main'
                                      ,folders = sDNA_GH_search_path
                                      ,folders_error_msg = 'Please ensure a folder called %s' % package_name 
                                                          +' is created in '
                                                          +Grasshopper.Folders.DefaultUserObjectFolder                                                                    
                                                          +', containing main.py and all sDNA_GH python' 
                                                          +' files and subfolders. ' 
                                      ,modules_not_found_msg = 'Some sDNA_GH files may be missing.  Please copy'
                                                              +' sDNA_GH.zip into: '
                                                              +Grasshopper.Folders.DefaultUserObjectFolder
                                                              +', Unblock it if necessary, and then right click'
                                                              +' it and select Extract All... in that location. '
                                                              +' Ensure that main.py and all sDNA_GH python' 
                                                              +' files and subfolders are inside: '
                                                              +os.path.join(Grasshopper.Folders.DefaultUserObjectFolder
                                                                           ,package_name
                                                                           )
                                      )         


    logger = sDNA_GH.main.logger.getChild('launcher')
    output.set_logger(logger, flush = True)


    class MyComponent(component):
        pass  # Required.  Idiomatic to Grasshopper.  Must be called "MyComponent"  
            # too (it is looked for by the parser or scope checker?) otherwise 
            # Grasshopper may not find the subclass of on 
            # component.  Even though we overwrite this class on the next line
            # immediately below.  

    MyComponent = sDNA_GH.main.sDNA_GH_Component
    # Grasshopper calls MyComponent.RunScript automatically.


    if nick_name.replace(' ','').replace('_','').lower() == selftest:  


        unit_tests, _ = load_modules('sDNA_GH.tests.unit_tests'
                                            ,sDNA_GH_search_path
                                            )

        MyComponent._RunScript = MyComponent.RunScript
        MyComponent.package_location = sDNA_GH_search_path
        MyComponent.RunScript =  unit_tests.run_launcher_tests
        # Grasshopper calls MyComponent.RunScript automatically.
# ---------- end build_components_2 ----------
python = GhPythonScript()  # disabled
# ---------- python: Python ----------
#! /usr/bin/awk NR==3
# -*- coding: utf-8 -*-
# This module can be imported by Python but requires Grasshopper (Rhino3D) to run as a script

# MIT License

# Copyright (c) [2021] [Cardiff University, a body incorporated
# by Royal Charter and a registered charity (number:
# 1136855) whose administrative offices are at 7th floor 30-
# 36 Newport Road, UniversityCF24 0DE, Wales, UK]

# Permission is hereby granted, free of charge, to any person obtaining a copy
# of this software and associated documentation files (the "Software"), to deal
# in the Software without restriction, including without limitation the rights
# to use, copy, modify, merge, publish, distribute, sublicense, and/or sell
# copies of the Software, and to permit persons to whom the Software is
# furnished to do so, subject to the following conditions:

# The above copyright notice and this permission notice shall be included in all
# copies or substantial portions of the Software.

# THE SOFTWARE IS PROVIDED "AS IS", WITHOUT WARRANTY OF ANY KIND, EXPRESS OR
# IMPLIED, INCLUDING BUT NOT LIMITED TO THE WARRANTIES OF MERCHANTABILITY,
# FITNESS FOR A PARTICULAR PURPOSE AND NONINFRINGEMENT. IN NO EVENT SHALL THE
# AUTHORS OR COPYRIGHT HOLDERS BE LIABLE FOR ANY CLAIM, DAMAGES OR OTHER
# LIABILITY, WHETHER IN AN ACTION OF CONTRACT, TORT OR OTHERWISE, ARISING FROM,
# OUT OF OR IN CONNECTION WITH THE SOFTWARE OR THE USE OR OTHER DEALINGS IN THE
# SOFTWARE.



""" Main entry point to launch sDNA_GH if run as a script from an sDNA_GH 
GhPython component.

Imports the python package sDNA_GH and (re)defining the MyComponent(component) 
class.  Grasshopper instantiates this class in each such component, then 
calls its RunScript method 
(and recalls it on each Param update / recalculation).

There may be multiple components, all running this same launcher code.
Therefore we want the root logger to live in the sDNA_GH.main module
that they each import.  The logging system is configurable by the user,
but only through the options that are read in during the main package
import, and we want to create logs before this too, in this module.  So 
before a component has imported sDNA_GH.main, logging is routed through output, 
a callable instance of Output, with a cache, defined below.  After a logger has 
been set up according to the user's configuration, after the main package import,
output's cache is flushed through the normal logging system, 

Also, the Output class is used to define two Classes from this single 
code definition.  Python scripts can happily import themselves, but here
this is because launcher.py is itself part of the imported sDNA_GH python
package, imported by launcher.py in a GhPythoncomponent.  To achieve this, the 
code in this file needs to be copied into the sDNA_GH GhPython components 
during building of the components (e.g. via the code input Param), 

The behaviours can be different of course if changes are made to one and not
the other. e.g. if updated code is forgotten to be copied into the component.

A dummy MyComponent(component) class is defined in the script to appease
GhPython's parser, even though the definition we use is imported from the package

launcher.py can also run unittests in a component named "selftest" 
"""

__author__ = 'James Parrott'
__version__ = '0.02'



import sys
import os
import functools
import importlib


import_module = importlib.import_module
try:
    reload #type: ignore
except NameError:
    reload = importlib.reload

try:
    basestring #type: ignore
except NameError:
    basestring = str

sDNA_GH_package = 'sDNA_GH'               
reload_already_imported = False





class Output(object): 

    def set_logger(self, logger, flush = True):
        self.logger = logger
        if flush and self.tmp_logs:
            self.flush()

    def __init__(self
                ,tmp_logs = None
                ,logger = None
                ):
        if not isinstance(tmp_logs, list): #assert not isinstance(None, list)
            tmp_logs = []
        self.tmp_logs = tmp_logs
        self.set_logger(logger, flush = False)



    def store(self, message, logging_level):
        self.tmp_logs.append( (message, logging_level) )

    def __call__(self, message, logging_level = "INFO", logging_dict = {}):
        #type: (str, str, dict, list) -> str
        
        #logger.debug(s)

        if logging_dict == {} and self.logger is not None: 
            logging_dict = dict( DEBUG = self.logger.debug
                                ,INFO = self.logger.info
                                ,WARNING = self.logger.warning
                                ,ERROR = self.logger.error
                                ,CRITICAL = self.logger.critical
                                )

        logging_level = logging_level.upper()
        if logging_level in logging_dict:
            logging_dict[logging_level](message)
        else:
            self.store(message, logging_level)

        return '%s : %s ' % (logging_level, message)

    def __getattr__(self, attr):
        return functools.partial(self.__call__, logging_level = attr.upper())

    def flush(self):
        tmp_logs = self.tmp_logs[:] # __call__ might cache back to tmp_logs
        self.tmp_logs[:] = [] # Mutate list initialised with.  Avoid double 
                              # logging in case re - stored in tmp_logs
        for tmp_log_message, tmp_log_level in tmp_logs:
            self.__call__(tmp_log_message, tmp_log_level)

output = Output()


class InvalidArgsError(Exception):
    
    """Custom exception to log the error message, and to at least allow 
       attempts to give users actionable advice to fix the issue, in 
       the event of a problem.  
    """
    message_fmt = 'Invalid import args: %s'
    def __init__(self
                ,message_fmt = ''
                ,message = ''
                ,logger = output
                , **kwargs
                ):
        if message_fmt and isinstance(message_fmt, basestring):
            self.message_fmt = message_fmt
        if not message or not isinstance(message, basestring):
            message = self.message_fmt % kwargs
        logger.error(message)
        self.kwargs = kwargs
        super(Exception, self).__init__(message)    


class ModuleNameError(InvalidArgsError):
    message_fmt = 'Invalid module name: %s'


class FilePathError(InvalidArgsError):
    message_fmt = 'Invalid path to import module from: %s'


# We only know the sDNA version to import as a string.  This is more secure too.
def strict_import(module_name = ''
                 ,folder = ''
                 ,sub_folder = ''
                 ,logger = output
                 ,reload_already_imported = reload_already_imported
                 ):

    # type: (str, str, str, type[any], bool) -> type[any]
    """ Imports the named module from the specified folder\subfolder only, 
        and returns it.
        
        Avoids name clashes and casual hijack attempts.  In some 
        environments supporting a Python implementation (such as 
        GhPython in Grasshopper) it may not be desireable to ask the user 
        to set PYTHONPATH.  Hence here, we save sys.path to a tmp 
        variable, set sys.path to the specified folders, attempt the 
        import in a try: block, and restore sys.path in a finally: block
    """
    if not module_name or not isinstance(module_name, basestring):
        raise ModuleNameError(module_name = module_name
                             ,folder = folder
                             ,sub_folder = sub_folder
                             ,logger = logger
                             )
    logger.debug(module_name)
    if module_name in sys.modules:   # sys.modules is also shared between GHPython components 
                                     # (and is even saved until Rhino is closed).
        logger.debug('Module %s already in sys.modules' % module_name)
        if reload_already_imported:
            logger.debug('Reloading %s.... ' % module_name)
            reload(sys.modules[module_name]) # type: ignore
        return sys.modules[module_name]
    #
    #
    # Load module_name for first time:
    #
    #
    search_path = os.path.join(folder, sub_folder)

    if (search_path 
        and isinstance(search_path, basestring) 
        and os.path.isdir(search_path)):
        #
        logger.debug('Search path == %s' % search_path)
        #if search_folder_only:
        #    sys.path = [search_path]
        if search_path not in sys.path:
            sys.path.insert(0, search_path)
    else:
        raise FilePathError(module_name = module_name
                           ,search_path = search_path
                           ,logger = logger
                           )

    logger.debug('Trying import... ')
    module = import_module(module_name, '')           

    return module       


class ModulesNotFoundError(InvalidArgsError):
    message_fmt = 'Modules not found in any location %s'


def load_modules(m_names
                ,folders
                ,logger = output
                ,module_name_error_msg = 'Please supply valid names of modules to import, %s'
                ,folders_error_msg = 'Please supply valid folders to import from. %s'
                ,modules_not_found_msg = 'Specified modules not found in any folder, %s'):
    #type(str/ Iterable, list, type[any], str, str) -> tuple / None
    """ Tries to import all modules in m_names, from the first folder in 
        folders to contain a .py or .pyc files with the same name as each 
        module.

        Returns a tuple of all the modules and the path they were found in.  Else 
        raises a ModulesNotFoundError.
    """
    if not m_names or any( not isinstance(m_name, basestring) 
                               for m_name in m_names ):
        raise ModuleNameError(message_fmt = module_name_error_msg
                             ,m_names = m_names
                             ,logger = logger
                             )
    
    if isinstance(m_names, basestring):
        m_names = [m_names] 
    logger.debug('m_names == %s of type : %s' % (m_names, type(m_names).__name__))

    logger.debug('Testing paths : %s ' % folders)
    
    if isinstance(folders, basestring):
        folders = [folders]

    if not any(os.path.isdir(folder) or os.path.isdir(os.path.dirname(folder)) 
               for folder in folders
              ):
        raise FilePathError(message_fmt = folders_error_msg
                           ,m_names = m_names
                           ,logger = logger
                           )

    for folder in folders:
        logger.debug('Type(folder) : %s' % type(folder).__name__)
        logger.debug('Type(path) : %s path == %s' %(type(folder).__name__, folder))

        if os.path.isfile(folder):
            folder = os.path.dirname(folder)
        if all( any(os.path.isfile(os.path.join(folder, name.replace('.', os.sep) + ending)) 
                    for ending in ['.py','.pyc'] 
                   )
                for name in m_names
              ):
            #
            logger.debug('Importing %s' % repr(m_names))

            return tuple(strict_import(name, folder, '', logger = logger) 
                            for name in m_names
                        ) + (folder,)
            # tuple of modules, followed by the path to them
    raise ModulesNotFoundError(message_fmt = modules_not_found_msg
                              ,m_names = m_names
                              ,folders = folders
                              ,logger = logger
                              )



if __name__ == '__main__': # False in a compiled component.  But then the user
                           # can't add or remove Params to the component.  
    
    # Grasshopper will look for class MyComponent(component) in global scope
    # so a main function is a little tricky to define.

    from ghpythonlib.componentbase import executingcomponent as component
    import Grasshopper
    import scriptcontext as sc
    # The Grasshopper API imports are done here separately to
    # let the above functions be imported outside the GhPython
    # e.g. for testing


    sDNA_GH_search_paths = [ Grasshopper.Folders.DefaultUserObjectFolder ]

    nick_name = ghenv.Component.NickName #type: ignore


    sc.doc = ghdoc #type: ignore

    output.debug(sDNA_GH_search_paths)

    class sDNA_GH(object):
        pass

    error_message = 1
    sDNA_GH.main, _ = load_modules(m_names = sDNA_GH_package + '.main'
                                  ,folders = sDNA_GH_search_paths
                                  ,folders_error_msg = 'Please ensure a folder called %s' % sDNA_GH_package 
                                                        +' is created in '
                                                        +Grasshopper.Folders.DefaultUserObjectFolder                                                                    
                                                        +', containing main.py and all sDNA_GH python' 
                                                        +' files and subfolders. ' 
                                  ,modules_not_found_msg = 'Some sDNA_GH files may be missing.  Please copy'
                                                          +' sDNA_GH.zip into: '
                                                          +Grasshopper.Folders.DefaultUserObjectFolder
                                                          +', Unblock it if necessary, and then right click'
                                                          +' it and select Extract All... in that location. '
                                                          +' Ensure that main.py and all sDNA_GH python' 
                                                          +' files and subfolders are inside: '
                                                          +os.path.join(Grasshopper.Folders.DefaultUserObjectFolder
                                                                       ,sDNA_GH_package
                                                                       )
                                   )         


    logger = sDNA_GH.main.logger.getChild('launcher')
    output.set_logger(logger, flush = True)


    class MyComponent(component):
        pass  # Required.  Idiomatic to Grasshopper.  Must be called "MyComponent"  
            # too (it is looked for by the parser or scope checker?) otherwise 
            # Grasshopper may not find the subclass of on 
            # component.  Even though we overwrite this class on the next line
            # immediately below.  

    MyComponent = sDNA_GH.main.sDNA_GH_Component


    if nick_name.replace(' ','').replace('_','').lower() == 'selftest':  

        if sys.argv[0].endswith(os.path.join(sDNA_GH_package,'__main__.py')):   
            from .tests.unit_tests import unit_tests_sDNA_GH
        else:
            unit_tests_sDNA_GH, _ = load_modules('sDNA_GH.tests.unit_tests.unit_tests_sDNA_GH'
                                                ,sDNA_GH_search_paths
                                                )

        MyComponent._RunScript = MyComponent.RunScript
        MyComponent.RunScript = unit_tests_sDNA_GH.run_launcher_tests
# ---------- end python ----------
show_auto_options = GhPythonScript()  # -> out, a
# ---------- show_auto_options: Python ----------
__author__ = "James"
__version__ = "2022.06.21"

import rhinoscriptsyntax as rs

if x:
    options = x['options']
    print('\n'.join('%s == %s' % (attr, getattr(options, attr) )
                    for attr in options._fields
                    if attr.startswith('auto')
                    )
         )
    metas = x['metas']
    print('\n'.join('%s == %s' % (attr, getattr(metas, attr) )
                    for attr in metas._fields
                    if attr in ['show_all']
                    )
         )
# ---------- end show_auto_options ----------
unload_sdna = Unload_sDNA()  # -> out, a
# ---------- unload_sdna: Python ----------
#! /usr/bin/awk NR==3
# -*- coding: utf-8 -*-
# This module requires Grasshopper Python (Rhino3D)

# MIT License

# Copyright (c) [2021] [Cardiff University, a body incorporated
# by Royal Charter and a registered charity (number:
# 1136855) whose administrative offices are at 7th floor 30-
# 36 Newport Road, UniversityCF24 0DE, Wales, UK]

# Permission is hereby granted, free of charge, to any person obtaining a copy
# of this software and associated documentation files (the "Software"), to deal
# in the Software without restriction, including without limitation the rights
# to use, copy, modify, merge, publish, distribute, sublicense, and/or sell
# copies of the Software, and to permit persons to whom the Software is
# furnished to do so, subject to the following conditions:

# The above copyright notice and this permission notice shall be included in all
# copies or substantial portions of the Software.

# THE SOFTWARE IS PROVIDED "AS IS", WITHOUT WARRANTY OF ANY KIND, EXPRESS OR
# IMPLIED, INCLUDING BUT NOT LIMITED TO THE WARRANTIES OF MERCHANTABILITY,
# FITNESS FOR A PARTICULAR PURPOSE AND NONINFRINGEMENT. IN NO EVENT SHALL THE
# AUTHORS OR COPYRIGHT HOLDERS BE LIABLE FOR ANY CLAIM, DAMAGES OR OTHER
# LIABILITY, WHETHER IN AN ACTION OF CONTRACT, TORT OR OTHERWISE, ARISING FROM,
# OUT OF OR IN CONNECTION WITH THE SOFTWARE OR THE USE OR OTHER DEALINGS IN THE
# SOFTWARE.

""" Unload the sDNA_GH Python package and all sDNA modules, by removing them from GhPython's shared cache (sys.modules).  The 
    next sDNA_GH component to run will then reload the package and installation-wide options file (config.toml), and any specified 
    options including a project specific config.toml, without otherwise having to restart Rhino to clear its cache.
"""

__author__ = 'James Parrott'
__version__ = '0.04'


from ghpythonlib.componentbase import executingcomponent as component

class MyComponent(component):
    
    def RunScript(self, unload, update):
        import sys  #Imported here to avoid weird bug 
                    # (unloading/forgetting of sys - IronPython only?)
        #https://discourse.mcneel.com/t/failed-import-of-sys-library-in-ghpython/98696


        print('sDNA_GH packages and modules in sys.modules:')
        print('\n'.join([key for key in sys.modules if 'sdna' in key.lower()]))
        def is_imported(s):
            return s in sys.modules
        if unload is True:
            if 'logging' in sys.modules:
                sys.modules['logging'].shutdown()
            shared_cached_modules_etc = sys.modules.copy().keys()
            for y in shared_cached_modules_etc:
                if 'sdna' in y.lower():
                    del sys.modules[y]
        
        
                
        print('sDNA_GH imported == %s' % is_imported('sDNA_GH'))
        print('sDNA_GH.tools imported == %s' % is_imported('sDNA_GH.tools'))
        print('sDNAUISpec imported == %s' % is_imported('sDNAUISpec'))
        print('runsdnacommand == %s' % is_imported('runsdnacommand'))

        
        return
# ---------- end unload_sdna ----------
config = GhPythonScript()  # disabled; same code as python
delete_sdna_gh = Button()
panel_2 = Panel(build_components_2.out)
update = Button()
self_test = GhPythonScript()  # -> out; disabled; same code as python
unload_sdna_2 = Unload_sDNA(unload=delete_sdna_gh, update=update)  # -> out, a
# ---------- unload_sdna_2: Python ----------
#! /usr/bin/awk NR==3
# -*- coding: utf-8 -*-
# This module requires Grasshopper Python (Rhino3D)

# MIT License

# Copyright (c) [2021] [Cardiff University, a body incorporated
# by Royal Charter and a registered charity (number:
# 1136855) whose administrative offices are at 7th floor 30-
# 36 Newport Road, UniversityCF24 0DE, Wales, UK]

# Permission is hereby granted, free of charge, to any person obtaining a copy
# of this software and associated documentation files (the "Software"), to deal
# in the Software without restriction, including without limitation the rights
# to use, copy, modify, merge, publish, distribute, sublicense, and/or sell
# copies of the Software, and to permit persons to whom the Software is
# furnished to do so, subject to the following conditions:

# The above copyright notice and this permission notice shall be included in all
# copies or substantial portions of the Software.

# THE SOFTWARE IS PROVIDED "AS IS", WITHOUT WARRANTY OF ANY KIND, EXPRESS OR
# IMPLIED, INCLUDING BUT NOT LIMITED TO THE WARRANTIES OF MERCHANTABILITY,
# FITNESS FOR A PARTICULAR PURPOSE AND NONINFRINGEMENT. IN NO EVENT SHALL THE
# AUTHORS OR COPYRIGHT HOLDERS BE LIABLE FOR ANY CLAIM, DAMAGES OR OTHER
# LIABILITY, WHETHER IN AN ACTION OF CONTRACT, TORT OR OTHERWISE, ARISING FROM,
# OUT OF OR IN CONNECTION WITH THE SOFTWARE OR THE USE OR OTHER DEALINGS IN THE
# SOFTWARE.

""" Unload the sDNA_GH Python package and all sDNA modules, by removing them from GhPython's shared cache (sys.modules).  """

__author__ = 'James Parrott'
__version__ = '0.03'


from ghpythonlib.componentbase import executingcomponent as component

class MyComponent(component):
    
    def RunScript(self, unload, update):
        import sys  #Imported here to avoid weird bug 
                    # (unloading/forgetting of sys - IronPython only?)
        #https://discourse.mcneel.com/t/failed-import-of-sys-library-in-ghpython/98696


        print('sDNA_GH packages and modules in sys.modules:')
        print('\n'.join([key for key in sys.modules if 'sdna' in key.lower()]))
        def is_imported(s):
            return s in sys.modules
        if unload is True:
            if 'logging' in sys.modules:
                sys.modules['logging'].shutdown()
            shared_cached_modules_etc = sys.modules.copy().keys()
            for y in shared_cached_modules_etc:
                if 'sdna' in y.lower():
                    del sys.modules[y]
        
        
                
        print('sDNA_GH imported == %s' % is_imported('sDNA_GH'))
        print('sDNA_GH.tools imported == %s' % is_imported('sDNA_GH.tools'))
        print('sDNAUISpec imported == %s' % is_imported('sDNAUISpec'))
        print('runsdnacommand == %s' % is_imported('runsdnacommand'))

        
        return
# ---------- end unload_sdna_2 ----------
panel_3 = Panel(unload_sdna_2.out)
readme_getter = GhPythonScript()  # -> out, a
# ---------- readme_getter: Python ----------
import os

from ghpythonlib.componentbase import executingcomponent as component
import Grasshopper, GhPython
import System
import Rhino
import rhinoscriptsyntax as rs

def text_file_to_str(file, extra_new_line_char = '', encoding = 'utf-8'):
    #type(str, str) -> str
    """ A simple text file reader.  """
    if file is None or not isinstance(file, basestring):
        msg = 'file == %s is not a string' % file
        logger.error(msg)
        raise TypeError(msg)
    elif not os.path.isfile(file):
        msg = 'file == %s is not a file path' % file
        logger.error(msg)
        raise ValueError(msg)
    else:
        with open(file, 'rb') as f:
            file_contents = extra_new_line_char.join(line.decode(encoding)
                                                     for line in f
                                                    )
    return file_contents

class MyComponent(component):
    
    def RunScript(self, x, y):
        
        sDNA_GH_path = os.path.dirname(ghdoc.Path)
        
        README_md_path = os.path.join(sDNA_GH_path, 'README.md')
        if not os.path.isfile(README_md_path):
            README_md_path = os.path.join(os.path.dirname(sDNA_GH_path), 'README.md')
        # Readme.md is a level higher in the repo than in the sDNA_GH
        # folder in a user installation - it is moved intentionally
        # by create_release_sDNA_GH_zip.bat 
        readme = text_file_to_str(README_md_path)
        a = 'anything'
        
        doc = self.Attributes.Owner.OnPingDocument()
        readme_component = next(component 
                                for component in doc.Objects
                                if component.NickName == 'Readme.txt'
                               ) 
        
        readme_component.SetUserText(readme)
        
        return a
# ---------- end readme_getter ----------
readme_txt = Panel("""# sDNA_GH
sDNA is a world leading tool for Spatial Design Network Analysis.  sDNA_GH is a plug-in for Grasshopper providing components that run the tools from a local [sDNA](https://github.com/fiftysevendegreesofrad/sdna_open/releases) installation, on Rhino and Grasshopper geometry and data.  

## sDNA
sDNA is able to calculate Betweenness, Closeness, Angular distance, and many other quantities including custom hybrid metrics, and is able to perform many other advanced functions as well.  Please note, for results of a network analysis to be meaningful, it must be ensured that the network is first properly [prepared](https://sdna-open.readthedocs.io/en/latest/network_preparation.html).

## sDNA_GH functionality
sDNA_GH: 
 - Reads a network's polyline Geometry from Rhino or Grasshopper, and Data from any User Text on it. 
 - Writes the network polylines (formed by one or more polylines) and user Data to a Shapefile.  
 - Initiates an sDNA tool that processes that shapefile, and e.g. carries out a network preparation or an analysis.
 - Reads the shapefile produced by the sDNA tool.
 - Displays the results from sDNA by colouring a new layer of new polylines or the original ones.

## User manual.  
### System Requirements. 
#### Software
1. Windows 10 or 8.1 (not tested in Windows 11) 
2. Python 2.7.  Please note Iron Python 2.7 does not run sDNA correctly (as incorrect shapefiles are produced).
3. sDNA. 
4. Rhino and Grasshopper (tested in Rhino 7)
#### Hardware
1. 64-bit Intel or AMD processor (Not ARM) 
2. No more than 63 CPU Cores. 
3. 8 GB memory (RAM) or more is recommended. 
4. 1.2 GB disk space. 

### Installation.
1. Ensure you have an installation of [Rhino 3D](https://www.rhino3d.com/download/) including Grasshopper (versions 6 and 7 are supported).
2. Ensure you have an installation of [Python 2.7](http://www.python.org/ftp/python/2.7.3/python-2.7.3.msi) [^0]  that can run sDNA correctly from the command line.  sDNA_GH runs sDNA from the command line.  Command line use of sDNA has been tested with Python versions 2.6 and 2.7 .  Do not run sDNA with Iron Python 2.7, as invalid shape files may be produced (it is not possible to access the Iron Python shipped with Rhino from the command line, in any case).  
3. To use sDNA with sDNA_GH, ensure you have an installation of [sDNA](https://sdna-open.readthedocs.io/en/latest/installation_usage.html).  sDNA itself may require the 64 bit Visual Studio 2008 redistributable, available [here](https://docs.microsoft.com/en-us/cpp/windows/latest-supported-vc-redist?view=msvc-170#visual-studio-2008-vc-90-sp1-no-longer-supported) or [here](https://download.microsoft.com/download/5/D/8/5D8C65CB-C849-4025-8E95-C3966CAFD8AE/vcredist_x64.exe ) ). 
4. Download `sDNA_GH.zip` from [food4Rhino](https://www.food4rhino.com) or the [sDNA_GH releases page on Github](https://www.example.com).
5. Ensure `sDNA_GH.zip` is unblocked: Open File Explorer and go to your Downloads folder (or whichever folder you saved it in).  Right click it and select `Properties` from the bottom of the menu.  Then click on the _Unblock_ check box at the bottom (right of _Security_), then click `OK` or `Apply`.  The check box and _Security_ section should disappear.  This should unblock all the files the zip archive.  If any files still need to be unblocked,  a [PowerShell](https://docs.microsoft.com/en-us/powershell/scripting/install/installing-powershell) script is provided in the zip file: `\sDNA_GH\dev_tools\batch_files\unblock_all_files_powershell.bat`[^2]   Please do not automatically trust and unblock all software downloaded from anywhere on the internet [^1].  
6. Open Rhino and Grasshopper.
7. In Grasshopper's pull down menus (above the tabs ribbon at the top) click `File` -> `Special folders` -> `User Objects Folder`.  The default in Rhino 7 is `%appdata%\Grasshopper\UserObjects`.  Note, this is not the Components Folder used by many other plug-ins (i.e. not `%appdata%\Grasshopper\Libraries`).
8. Copy in sDNA_GH.zip to this folder (e.g. it should be at `%appdata%\Grasshopper\UserObjects\sDNA_GH.zip`).
9. Unzip `sDNA_GH.zip` to this location (in Windows 10 right click `sDNA_GH.zip` and select `Extract All ...`, then click `Extract` to use the suggested location).  In the User Objects folder, a single subfolder called sDNA_GH should have been created.
10. Restart Rhino and Grasshopper.
11. The sDNA_GH plug in components should now be available under a new "sDNA_GH" tab in the ribbon tabs amongst any other plug-ins installed (right of `Mesh`, `Intersect`, `Transform` and `Display` etc).  
12. To use sDNA with sDNA_GH, if no preferences are specified, sDNA_GH will search for sDNA and Python 2.7 installations automatically, using the first one of each it finds.  However to be sure sDNA_GH uses a particular version of sDNA and the correct Python 2.7 interpreter(and to be sure it can find one at all) it is recommended (on first usage only) to:
    -place a Config component on the canvas (the component with a lightbulb icon, under Support Tools).
    -Specify the file path of the sDNA folder (containing sDNAUISpec.py and runsdnacommand.py) of the sDNA you wish to use in the `sDNA_folders` input.
    -Specify the file path of the Python 2.7 interpreter's main executable in the `python` input.
    -Specify any other options you wish to save and reuse on all projects, if necessary by adding custom input Params with the option's name.
    -Connect a True boolean toggle to `go`.  An installation wide user options file (`config.toml`) will be created if there isn't one already.
    -To save to other project specific `config.toml` files, specify the file path in save_to and repeat the previous 4 sub steps.

13. For a first test of sDNA_GH using sDNA, open  `\sDNA_GH\tests\5x18_random_grid_network.3dm` (in the previously unzipped folder in the User Objects folder), place an sDNA_Integral component and connect a True boolean toggle to its `go`.  
14. If a newer version of sDNA is used in future with tools unknown to sDNA_GH at the time it was built, if a Config component is placed, and the path of the new sDNA specified in `sDNA_folders`, sDNA_GH will attempt to automatically build components and user objects for the new sDNA tools, and add them to Grasshopper for you.  Set `make_new_comps` to false to prevent this.


### Usage.  
#### Components.
##### Automatic multi-tools.
Each sDNA tool has its own a Grasshopper component.  To run a tool, a True value, e.g. from a Boolean toggle component, must be connected to its component's `go` Input Param [^note].  To group together common work flows (unless an `auto_` option is set not to) some tools by default also automatically run other tools before or after they run themselves.  For example, this allows an entire sDNA process to be run on Rhino Geometry, with the results from the sDNA calculation being used to recolour the Rhino geometry, from one single sDNA tool component.  When placed on the canvas, each component adds in Params for all its required Input and Output arguments (if the Params are not already present), including those of any extra automatically added tools.  Extra customisation can be carried out by adding in extra Params too.  Such extra user added Params are not removed.  This can make the components quite large, but any Params not being specified can be removed.  Another way to make the components smaller, that also allows any other custom work to be carried out in between individual tools, is to set the `auto_` options for that component to `false`.  A newly placed component will then only add in the Params for that component's own tool.

[note] All except the Config tool which always loads its options when placed or its Inputs are updated (saving options when `go` is true), and Unload_sDNA on which `unload` does the same thing as `go`.

##### Running individual tools.  
Multiple sDNA_GH components can be chained together to run in sequence by connecting the `OK` Output Param of one component, to the `go` Input Param of the component(s) to be run afterwards.
To work with a Grasshopper Colour Gradient tool, to show fewer Input and Output Params on each component, or to customise sDNA_GH behaviour, e.g. to connect in different inputs and outputs between individual tools running, advanced users may prefer to run only one tool per sDNA_GH component.  To do this, simply 'turn off' the `auto_` options: `auto_get_Geom`, `auto_read_User_Text`, `auto_write_Shp`, `auto_read_Shp` and `auto_plot_data` by setting them to `false`, e.g. on a Config component.  How to do this is described below in more detail.  

##### Component Execution Order.
**Warning!**   If you did not create a `config.toml` file (in Installation step 12 above), and if you rely instead on components inside your .gh file itself to set option values, e.g. `Config` components to determine options, be sure to select and press `Ctrl` + `B` (or from the pull-down menu select `Edit` -> `Arrange` -> `Put To Back`) to to send to the back, any components that should run first whn you reload the .gh file.  E.g. send to the back all components that set options values that you wish other components to later depend on.  In particular if you are running with `auto_` options set to false, saved single-tool components will rebuild themselves as multi-tool components when a .gh file  is loaded,  if sDNA_GH's hard-coded default options are read before your custom options.  As even if these were set and read correctly, they are on a component that hasn't run yet, that Grasshopper doesn't know about yet. 

##### Errors.
Errors that occur while the components import the main sDNA_GH Python package  and when they initialise themselves must be cleared by deleting the component and placing a new one.  It may also be necessary to first unload the sDNA_GH package using the unload component, to clear sDNA_GH from GPython's cached modules, and force it to be reimported.  

#### Options.  
sDNA_GH is highly customisable.  This customisation is controlled by setting options.  Any option in a component can be read by adding an Output Param and renaming it to the name of the option.  Similarly, any option in a component can be changed by adding an Input Param and renaming it to the name of the option, and connecting it to the new value.  Entire options data structures (`opts`) may also be passed in from other components as well, via Grasshopper connections. 

##### Adding Component Input and Output Params.  
To add a new Input or Output Param, zoom in on the component until symbols can be seen.  Click on the one where you want the new Param.  Right click the new Param's name and to rename it to the desired option, click its name (e.g. x, y or z for an Input Param, or a,b or c for an Output Param).

##### Logging options
When the first sDNA_GH component is placed (or when the first one runs when a .gh file is loaded) you may notice a slight delay.  This is because the main sDNA_GH code base is being imported from the installation sub folder in the User Objects folder.  Subsequent components simply link to it once it has already been imported.  This happens before a component knows what its input Params are.  The installation wide options file is read and the main logger for trouble shooting is created during this first import.  Therefore unlike other options, custom logger options for configuring the logger (e.g. making it less verbose by raising the logging level from `DEBUG`) must be set in the installation wide options file (`config.toml`).  Like other options, logger options are overridden by other files, components and Input Params afterwards.  Only as the logger has already been set up by the time the Input Params are created, it's simply too late by then for changes to logger options (made using what are normally the higher priority channels) to have any effect.  Supported values for logging levels are: `DEBUG`, `INFO`, `WARNING`, `ERROR` and `CRITICAL`.
 
###### Options override priority order
1. The component input Param options override options in a project specific options file (`config`).  
2. A project specific options file (specified in `config`) overrides options from another sDNA_GH component.  
3. Options from another sDNA_GH component override the installation-wide options file (e.g. `%appdata%\Grasshopper\UserObjects\sDNA_GH\config.toml`).  
4. The installation-wide options file overrides the sDNA_GH hard-coded default options in `main.py` [^note]
[note] Dev note: the options in `main.py` themselves override every individual tool's default options in `tools.py`.


###### Name map (abbreviations, NickNames and work flows)
After `config`, the next most important meta option is `name_map`, in which custom NickNames for user-created sDNA_GH components (and entire work sequences of tools) may be defined. 

##### Component NickName.
The particular tool or tools a module runs is controlled by its NickName (accessible in the local meta option NickName), but which can be changed by simply renaming the component.  The component then looks up in the meta option name_map to see which (if any)
tool or tools (including other NickNames) its NickName corresponds to, then retrieves these tools from the cache (building them if they do not exist already).  sDNA tools automatically add their own default options and syntax in their initialiser (and add new ones if their NickName or the version of sDNA subsequently changes).  

##### Tool options.
Each NickName in name map creates a new set of options.  These contain options for each tool (real name) in the list of tools used under that NickName.  Each of these has a set of options for each version of sDNA encountered by the component so far.  Primarily this is where the settings for sDNA wrapper tools are stored (apart from a couple of helper overrides, like `file`).  Support tools and sDNA_GH tools use options and meta options in the common name root space (which is the same for all sDNA versions sDNA_GH has found).  

##### Local meta options.
By default all sDNA_GH components share (and may change) the same global dictionary of options (module options, tool options, and *meta* options, together in *opts*) in the `main.py` module.  If only one of each tool is needed (and there is only one version of sDNA), that will suffice for most users.  

For advanced users, each component with a given NickName in name_map also has its own set of tool options (one for each version of sDNA).  However, for one support component to have a different set of options to another, one of them must no longer update the global options dictionary - it must de-synchronise from them.  This syncing and de-syncing is controlled by each component's individual *local meta options*, (in `local_metas`) `sync_to_module_opts`, `read_from_shared_global_opts`.  By default these booleans are both equal to True.  More than one project specific options file (`config.toml`) can then be supported on the same canvas.  Just create the files, and specify the name of the one you wish to be used on the `config` input of the desired components (or connect their `opts` to one with this `config`).  Just like other options, *local metas* can be set in Input Params, read from Output Params, shared between components via Grasshopper connections in the same way as opts, can be set by project config files(`config.toml`) and set in the installation-wide config file (e.g. `%appdata%\Grasshopper\UserObjects\sDNA_GH\config.toml`).  But unlike *meta options*, *local metas* are not updated automatically by syncing to the main module options (as this would defeat their entire purpose).


#### Tools.
##### Common component input and output Params
**OK** This output is `true` when a component has executed successfully.
**go** Set this input to `true` (e.g. from a boolean toggle component) to run a component's tool.
**file** Specifies the path of a file to write to, or that was written to.
**Data** Accepts a data tree of keys and values.
**Geom** Accepts a list of geometric objects (Rhino or Grasshopper).  Data trees of objects need to be flattened.
**gdm** Accepts a Geometry-data-mapping, a python nested dictionary.  The keys are the IDs of geometric objects.  The values are also dictionaries, containing key/value pairs for use as User Text.
**opts** Accepts an options data structure (a nested dictionary of named tuples) from another sDNA_GH component.  Only of use if they are not synced to the global module options.
**config** The path of a TOML file (e.g. `config.toml`) to be read in containing sDNA_GH options settings. 

##### Support tools
###### Config (config)
To guarantee this component runs before all others when your .gh file is loaded, ensuring your options are loaded, select it and press Ctrl + B before saving.
Loads custom user options and configuration files (`.toml`).  Saves options to a `.toml` file if go is true.  If a `.toml` file is specified in `save_to`, it is saved to.  Otherwise the default value of `save_to` is the installation-wide user options file.  One is created if it does not already exist.  This will overwrite existing files.


###### Read_Geom (get_Geom)
Reads in references to Rhino geometry (polylines) to provide them in the required form for subsequent sDNA_GH tools.  Set the option `selected` to true, to only read selected Rhino objects (of the specified type - polylines).  Similarly, specify `layer` = your_layer_name to only read Rhino objects from the layer named your_layer_name.  To go back to selecting all layers, set `layer` to any value that is not the name of a layer.


The UUIDs of the Rhino objects are converted to strings to preserve the references to them.  


##### Shapefile tools
###### Write_Shp (write_shapefile)
Writes the DataTree in `Data` and list of `Geom`etric objects (polylines) to a shapefile.  If not specified in `file`, a file name based on the Rhino doc or Grasshopper doc name is used (unless `auto_update_Rhino_doc_path = false`).  Overwrites existing files, or creates new files.  To create a projection (.prj) file for the new shapefile, specify the path of an existing .prj file in `prj`.  If no Data is supplied it will first call read_User Text (unless `auto_read_User_Text` is false).  To work with sDNA, data records are only written to the Shapefile (associated with a shape corresponding to a Rhino / GH polyline) if its field (key name if it originated as User Text) matches the template string specified in `input_key_str`.  To write all data with any key name to the Shapefile, set it to `{all}`.


###### Read_Shp (read_shapefile)
Reads in polylines and associated data records from a shapefile.  Creates new objects unless existing objects are specified in `Geom`.  Specify the path of the .shp file to read in `file`.  **WARNING!  Read_Shp automatically deletes the shapefile after reading it in,if `strict_no_del` = false, if either a) the file name matches the pattern in either `output_fmt` or `prepped_fmt`, or b) if `del_after_read` = true.**  If a list of existing geometry is provided in `Geom` that corresponds to (is the same length as) the data records in the shapefile, only the data is read from the shapefile.  Otherwise the shapes in the shapefile are outputted as new Grasshopper Geometry objects.  The bounding box output `bbox` is provided to create a legend frame within Recolour_Objects.  The abbreviations and field names from an sDNA results field file (if a file with the same name ending in .names.csv exists) are also read in, and supplied on `abbrevs` so that a drop-down list may be created, for easy selection of the data field for subsequent parsing and plotting.  If no separate Recolour_Objects Component is detected connected to the component's outputs downstream (unless `auto_plot_data = false`), Recolour_Objects is called afterwards.  


##### Plotting tools
###### Parse_Data (parse_data)
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""")
